# Grasshopper definition Chair.gh (Grasshopper 1.0.7)

number_slider = Slider(3, range=0..10)
number_slider_2 = Slider(3, range=0..10)
number_slider_3 = Slider(3, range=0..10)
number_slider_4 = Slider(3, range=0..10)
xy_plane = XYPlane(Origin=Point(0, 0, 0))
xy_plane_2 = XYPlane(Origin=Point(0, 0, 0))
xy_plane_3 = XYPlane(Origin=Point(0, 0, 0))
xy_plane_4 = XYPlane(Origin=Point(0, 0, 0))
number_slider_5 = Slider(2.5, range=0..10)
rectangle = Rectangle(Plane=xy_plane, XSize=number_slider, YSize=number_slider, Radius=Slider(5, range=0..10))  # -> Rectangle, Length
rectangle_2 = Rectangle(Plane=xy_plane_2, XSize=number_slider_2, YSize=number_slider_2, Radius=Slider(5, range=0..10))  # -> Rectangle, Length
rectangle_3 = Rectangle(Plane=xy_plane_3, XSize=number_slider_3, YSize=number_slider_3, Radius=Slider(5, range=0..10))  # -> Rectangle, Length
rectangle_4 = Rectangle(Plane=xy_plane_4, XSize=number_slider_4, YSize=number_slider_4, Radius=Slider(5, range=0..10))  # -> Rectangle, Length
vector_xyz = VectorXYZ(XComponent=number_slider_5, YComponent=number_slider_5, ZComponent=0)  # -> Vector, Length
vector_xyz_2 = VectorXYZ(XComponent=Slider(2.5, range=0..10), YComponent=0, ZComponent=0)  # -> Vector, Length
vector_xyz_3 = VectorXYZ(XComponent=0, YComponent=Slider(2.5, range=0..10), ZComponent=0)  # -> Vector, Length
move = Move(Geometry=rectangle_4.Rectangle, Motion=vector_xyz.Vector)  # -> Geometry, Transform
move_2 = Move(Geometry=rectangle.Rectangle, Motion=vector_xyz_2.Vector)  # -> Geometry, Transform
move_3 = Move(Geometry=rectangle_3.Rectangle, Motion=vector_xyz_3.Vector)  # -> Geometry, Transform
number_slider_6 = Slider(5, range=0..10)
xy_plane_5 = XYPlane(Origin=Point(0, 0, 0))
number_slider_7 = Slider(0, range=-10..10)
rectangle_5 = Rectangle(Plane=xy_plane_5, XSize=number_slider_6, YSize=number_slider_6, Radius=Slider(1, range=0..10))  # -> Rectangle, Length
vector_xyz_4 = VectorXYZ(XComponent=number_slider_7, YComponent=number_slider_7, ZComponent=Slider(8.219, range=-10..10))  # -> Vector, Length
move_4 = Move(Geometry=rectangle_5.Rectangle, Motion=vector_xyz_4.Vector)  # -> Geometry, Transform
number_slider_8 = Slider(2.5, range=0..10)
construct_point = ConstructPoint(XCoordinate=number_slider_8, YCoordinate=number_slider_8, ZCoordinate=0)
construct_point_2 = ConstructPoint(XCoordinate=number_slider_8, YCoordinate=number_slider_8, ZCoordinate=Slider(10, range=0..10))
loft = Loft(
    Curves=[move_4.Geometry, move.Geometry],
    Options={Adjust=False, Closed=False, LoftEnds=0, LoftSimp=0, LoftType=0, Rebuild=10, Refit=0.01})
loft_2 = Loft(
    Curves=[move_4.Geometry, move_3.Geometry],
    Options={Adjust=False, Closed=False, LoftEnds=0, LoftSimp=0, LoftType=0, Rebuild=10, Refit=0.01})
loft_3 = Loft(
    Curves=[move_2.Geometry, move_4.Geometry],
    Options={Adjust=False, Closed=False, LoftEnds=0, LoftSimp=0, LoftType=0, Rebuild=10, Refit=0.01})
loft_4 = Loft(
    Curves=[rectangle_2.Rectangle, move_4.Geometry],
    Options={Adjust=False, Closed=False, LoftEnds=0, LoftSimp=0, LoftType=0, Rebuild=10, Refit=0.01})
number_slider_9 = Slider(0.5, range=0..10)
number_slider_10 = Slider(0.5, range=0..10)
xy_plane_6 = XYPlane(Origin=Point(0, 0, 0))
xy_plane_7 = XYPlane(Origin=Point(0, 0, 0))
xz_plane = XZPlane(Origin=Point(0, 0, 0))
cap_holes = CapHoles(Brep=loft_3)
cap_holes_2 = CapHoles(Brep=loft_2)
cap_holes_3 = CapHoles(Brep=loft)
cap_holes_4 = CapHoles(Brep=loft_4)
line = Line(StartPoint=construct_point, EndPoint=construct_point_2)
vector_xyz_5 = VectorXYZ(XComponent=Slider(2.995, range=0..10), YComponent=Slider(3.4, range=0..10), ZComponent=Slider(8, range=0..10))  # -> Vector, Length
vector_xyz_6 = VectorXYZ(XComponent=Slider(0.333, range=0..10), YComponent=Slider(3.4, range=0..10), ZComponent=Slider(8, range=0..10))  # -> Vector, Length
rectangle_6 = Rectangle(Plane=xy_plane_6, XSize=number_slider_9, YSize=number_slider_9, Radius=Slider(5, range=0..10))  # -> Rectangle, Length
solid_union = SolidUnion(Breps=[cap_holes_2, cap_holes, cap_holes_3, cap_holes_4])
rectangle_7 = Rectangle(Plane=xy_plane_7, XSize=number_slider_10, YSize=number_slider_10, Radius=Slider(5, range=0..10))  # -> Rectangle, Length
rectangle_8 = Rectangle(Plane=xz_plane, XSize=Slider(4, range=0..10), YSize=Slider(2, range=0..10), Radius=Slider(0.246, range=0..10))  # -> Rectangle, Length
vector_xyz_7 = VectorXYZ(XComponent=0, YComponent=Slider(3.133, range=-10..10), ZComponent=Slider(9.621, range=-10..10))  # -> Vector, Length
twist = Twist(Geometry=solid_union, Axis=line, Angle=Slider(5.75, range=0..10), Infinite=Toggle(True), Rigid=False)
move_5 = Move(Geometry=rectangle_6.Rectangle, Motion=vector_xyz_5.Vector)  # -> Geometry, Transform
move_6 = Move(Geometry=rectangle_7.Rectangle, Motion=vector_xyz_6.Vector)  # -> Geometry, Transform
move_7 = Move(Geometry=rectangle_8.Rectangle, Motion=vector_xyz_7.Vector)  # -> Geometry, Transform
unit_y = UnitY(Factor=Slider(1, range=0..1))
unit_z = UnitZ(Factor=Slider(2, range=0..10))
unit_z_2 = UnitZ(Factor=Slider(2, range=0..10))
extrude = Extrude(Base=move_7.Geometry, Direction=unit_y)
extrude_2 = Extrude(Base=move_5.Geometry, Direction=unit_z)
extrude_3 = Extrude(Base=move_6.Geometry, Direction=unit_z_2)
cap_holes_5 = CapHoles(Brep=extrude)
cap_holes_6 = CapHoles(Brep=extrude_3)
cap_holes_7 = CapHoles(Brep=extrude_2)
solid_union_2 = SolidUnion(Breps=[cap_holes_5, cap_holes_6, cap_holes_7])
cap_holes_8 = CapHoles(Brep=solid_union_2)
unit_x = UnitX(Factor=Slider(0.5, range=0..1))
move_8 = Move(Geometry=cap_holes_8, Motion=unit_x)  # -> Geometry, Transform
solid_union_3 = SolidUnion(Breps=[move_8.Geometry, twist])
